# Grasshopper definition ClasticSrf.gh (Grasshopper 1.0.7)

size = GetNumber(
    Slider(12, range=1..12),
    AtLeast=1,
    AtMost=1,
    Maximum=1.797693135e+308,
    Minimum=-1.797693135e+308,
    Prompt="size of the surface [1.0 ... 12.0]",
    TreeAccess=False)
bendiness = GetNumber(
    Slider(-1.7, range=-10..10),
    AtLeast=1,
    AtMost=1,
    Maximum=1.797693135e+308,
    Minimum=-1.797693135e+308,
    Prompt="float of curvature - negative will be antisynclastic, positive will be synclastic [-10.0...10.0]",
    TreeAccess=False)
circle = Circle(Plane=PlaneXY(0, 0, 0), Radius=size)
divide_curve = DivideCurve(Curve=circle, Count="4", Kinks=False)  # -> Points, Tangents, Parameters
list_item = ListItem(List=divide_curve.Points, Index=0, Wrap=True)  # -> Item, Item1, Item2
point = Point(list_item.Item1)
point_2 = Point(list_item.Item)
point_3 = Point(list_item.Item2)
distance = Distance(PointA=point, PointB=point_2)
absolute = Absolute(Value=bendiness)
distance_2 = Distance(PointA=point, PointB=point_3)
addition = Addition(A=distance, B=absolute)
addition_2 = Addition(A=distance_2, B=absolute)
unit_z = UnitZ(Factor=absolute)
unit_z_2 = UnitZ(Factor=bendiness)
catenary = Catenary(PointA=point, PointB=point_2, Length=addition, Gravity=unit_z)
catenary_2 = Catenary(PointA=point, PointB=point_3, Length=addition_2, Gravity=unit_z_2)
divide_curve_2 = DivideCurve(Curve=catenary_2, Count=10, Kinks=False)  # -> Points, Tangents, Parameters
vector_2pt = Vector2Pt(PointA=point, PointB=divide_curve_2.Points, Unitize=False)  # -> Vector, Length
move = Move(Geometry=catenary, Motion=vector_2pt.Vector)  # -> Geometry, Transform
loft = Loft(Curves=move.Geometry, Options={Adjust=True, Closed=False, LoftEnds=0, LoftSimp=1, LoftType=0, Rebuild=10, Refit=0.01})
surface = Surface(loft)
context_bake = ContextBake(SurfaceOut=surface)
